# Dynamo graph Dynamo all in one script.dyn (Dynamo 3.6.1.9895)

python_script = Python()  # CPython3; unwired: IN[0]
# ---------- python_script.python (85 lines) ----------
import clr
clr.AddReference("RevitAPI")
clr.AddReference("RevitServices")

from Autodesk.Revit.DB import *
from Autodesk.Revit.DB.Plumbing import PipingSystem
from RevitServices.Persistence import DocumentManager

doc = DocumentManager.Instance.CurrentDBDocument

data = []

# 🔧 Safe ElementId
def eid(elem_id):
    try:
        return str(elem_id.Value)
    except:
        return str(elem_id.IntegerValue)

# 🔹 Hitta vatten-system
valid_ids = set()

systems = FilteredElementCollector(doc).OfClass(PipingSystem).ToElements()

for sys in systems:
    try:
        name = sys.Name.lower()

        if any(k in name for k in ["water", "cold", "hot", "cw", "hw", "sprink", "fire"]):
            try:
                for e in sys.PipingNetwork:
                    valid_ids.add(eid(e.Id))
            except:
                pass
    except:
        pass


# 🔹 Pipes
pipes = FilteredElementCollector(doc)\
    .OfCategory(BuiltInCategory.OST_PipeCurves)\
    .WhereElementIsNotElementType()\
    .ToElements()


def get_connectors(elem):
    try:
        return elem.ConnectorManager
    except:
        return None


for p in pipes:

    pid = eid(p.Id)

    if pid not in valid_ids:
        continue

    mgr = get_connectors(p)

    conn_count = 0
    connected_ids = []

    if mgr:
        try:
            for c in mgr.Connectors:
                conn_count += 1

                if c.IsConnected:
                    for ref in c.AllRefs:
                        owner = ref.Owner
                        if owner and owner.Id != p.Id:
                            connected_ids.append(eid(owner.Id))
        except:
            pass

    # 🔥 Output som LISTA av dicts (inte dict med int keys)
    data.append({
        "id": pid,
        "connectors": int(conn_count),
        "connected_to": connected_ids
    })

OUT = data
# ----------------------------------------
watch = Watch(python_script)
python_script_2 = Python(IN[0]=python_script)  # CPython3
# ---------- python_script_2.python (32 lines) ----------
data = IN[0]

orphans = []
dead_ends = []
isolated = []

for e in data:
    try:
        eid = e["id"]
        conn = e["connectors"]
        connected = len(e["connected_to"])

        # 🔴 Hard orphan (har connectors men ingen connection)
        if conn > 0 and connected == 0:
            orphans.append(eid)

        # 🟡 Dead-end (ska normalt vara genomgående rör)
        elif conn >= 2 and connected == 1:
            dead_ends.append(eid)

        # 🔵 Isolated (inga connectors alls)
        elif conn == 0:
            isolated.append(eid)

    except:
        pass

OUT = {
    "orphans": orphans,
    "dead_ends": dead_ends,
    "isolated": isolated
}
# ----------------------------------------
watch_2 = Watch(python_script_2)
python_script_3 = Python(IN[0]=python_script_2)  # CPython3
# ---------- python_script_3.python (118 lines) ----------
import clr
clr.AddReference("RevitAPI")
clr.AddReference("RevitServices")

from Autodesk.Revit.DB import *
from RevitServices.Persistence import DocumentManager
from RevitServices.Transactions import TransactionManager
from System.Collections.Generic import List

doc = DocumentManager.Instance.CurrentDBDocument
data = IN[0]

VIEW_NAME = "Colored 3D View"

# =====================================================
# SAFE ElementId
# =====================================================
def to_eid(id_str):
    try:
        return ElementId(int(id_str))
    except:
        return None

# =====================================================
# CREATE VIEW (ALWAYS NEW)
# =====================================================
TransactionManager.Instance.EnsureInTransaction(doc)

vft_collector = FilteredElementCollector(doc).OfClass(ViewFamilyType).ToElements()

view = None
for vft in vft_collector:
    if vft.ViewFamily == ViewFamily.ThreeDimensional:
        view = View3D.CreateIsometric(doc, vft.Id)
        view.Name = VIEW_NAME
        break

# 🔥 ta bort template
try:
    view.ViewTemplateId = ElementId.InvalidElementId
except:
    pass

TransactionManager.Instance.TransactionTaskDone()

# =====================================================
# GET SOLID FILL
# =====================================================
solid_fill_id = None
fills = FilteredElementCollector(doc).OfClass(FillPatternElement).ToElements()

for f in fills:
    try:
        if f.GetFillPattern().IsSolidFill:
            solid_fill_id = f.Id
            break
    except:
        pass

# =====================================================
# COLOR + COLLECT IDS
# =====================================================
TransactionManager.Instance.EnsureInTransaction(doc)

problem_ids = []
count = 0

def process(ids, color):
    global count

    for i in ids:
        eid = to_eid(i)
        if not eid:
            continue

        e = doc.GetElement(eid)
        if not e:
            continue

        problem_ids.append(e.Id)

        try:
            ogs = OverrideGraphicSettings()

            ogs.SetProjectionLineColor(color)
            ogs.SetCutLineColor(color)

            if solid_fill_id:
                ogs.SetSurfaceForegroundPatternId(solid_fill_id)
                ogs.SetSurfaceForegroundPatternColor(color)

            view.SetElementOverrides(e.Id, ogs)
            count += 1

        except:
            pass

# 🔴 ORPHANS
process(data["orphans"], Color(255, 0, 0))

# 🟡 DEAD ENDS
process(data["dead_ends"], Color(255, 255, 0))

# 🔵 ISOLATED
process(data["isolated"], Color(0, 255, 255))

# =====================================================
# 🔥 ISOLATE ELEMENTS (DETTA FIXAR ALLT)
# =====================================================
if problem_ids:
    try:
        view.IsolateElementsTemporary(List[ElementId](problem_ids))
    except:
        pass

TransactionManager.Instance.TransactionTaskDone()

OUT = "Created view + isolated {} problem elements".format(count)
# ----------------------------------------
watch_3 = Watch(python_script_3)
